# Dynamo graph node-sandbox.dyn (Dynamo 2.0.1.5055)

helloNode = HelloNode.HelloNode.HelloNode()
watch = Watch(helloNode)
helloMessage = HelloNode.HelloNode.HelloMessage()
watch_2 = Watch(helloMessage)
